# Grasshopper definition IfcJson viewer demo 2.0 python shell.gh (Grasshopper 1.0.7)

value_list = ValueList({"Column", "Beam", "Wall", "Footing", "Roof", "Slab", "Space", "FurnishingElement", "BuildingElementProxy", "Window", "Door"}, selected=["Column", "Beam", "Wall", "Slab", "FurnishingElement", "Window", "Door"])
concat = Concatenate(FragmentA="@.Class == '", FragmentB=value_list, FragmentC="' || ")  # -> flatten(Result)
join = TextJoin(Text=concat)
len = TextLength(Text=join)
subtraction = Subtraction(A=len, B=4)
fragment = TextFragment(Text=join, Start=0, Count=subtraction)
concat_2 = Concatenate(FragmentA="$..data[?(", FragmentB=fragment, FragmentC=")]")
_4_filter_by_class_checklist_slow = Panel(concat_2)

volume_filter = Slider(258750, range=0..500000)
concat_3 = Concatenate(FragmentA="$..data[?(@.Volume<", FragmentB=volume_filter, FragmentC=")]")

# ---- group: INPUT FILE
python_wall_door = FilePath("C:\Users\denni\Documents\GitHub\IFC.JSON-Grasshopper\test_files\7m900_tue_hello_wall_with_door.json")
duplex_a_all = FilePath("C:\Users\denni\Google Drive\BSI - Technical\IFCJSON_GH\json_read_python\Duplex_A_All.json")
_50korig = FilePath("C:\Users\denni\Google Drive\BSI - Technical\IFCJSON_GH\json_read_python\Duplex_A_LT50K.json")
clinic_s = FilePath("C:\Users\denni\Google Drive\BSI - Technical\IFCJSON_GH\json_read_python\Clinic_S3.json")
parsejsonfile = GhPythonScript(File=python_wall_door)  # -> out, data
# ---------- parsejsonfile: Python ----------
import json

if File:
    
    # JSON file to read
    file = open(File)
    
    # Load the data
    rawfile = json.load(file)
    
    data = rawfile.get("data")
    
    #info = [{"data": info }]
    
    # Do something with the data
    print data
# ---------- end parsejsonfile ----------
all_ifc_objects = Data(parsejsonfile.data)

# ----
panel = Panel("INPUTS")
duplex_a_arch = FilePath("C:\Users\denni\Google Drive\BSI - Technical\IFCJSON_GH\json_read_python\Duplex_A_Arch.json")
duplex_a_furn = FilePath("C:\Users\denni\Google Drive\BSI - Technical\IFCJSON_GH\json_read_python\Duplex_A_FurnishingElement.json")
duplex_a_mep = FilePath("C:\Users\denni\Google Drive\BSI - Technical\IFCJSON_GH\json_read_python\Duplex_MEP_out.json")
panel_2 = Panel("MESH PROCESSING")
panel_3 = Panel("PREVIEWS")
panel_4 = Panel(".Class")
panel_5 = Panel(parsejsonfile.out)

# ---- group: FILTERS
_0_filter_all = Panel("$..")
_1_filter_by_volume = Panel(concat_3)
_2_filter_by_class_user_edit = Panel("$..data[?(@.type == 'Wall')]")
_3_filter_boolean_combo = Panel("$..data[?((@.Class == 'Wall' ||  @.Class == 'Beam') && @.Volume<=20000.0)]")
select_filter = Slider(2, range=0..4)

# ----
item = ListItem(
    List=[_0_filter_all, _1_filter_by_volume, _2_filter_by_class_user_edit, _3_filter_boolean_combo, _4_filter_by_class_checklist_slow],
    Index=select_filter,
    Wrap=True)
filter_out = Panel(item)

# ---- group: FILTERS (continued)
jsonpath_filter = Data(filter_out)

# ----
all_ifc_objects_2 = Data(all_ifc_objects)
jsonpath_filter_2 = Data(jsonpath_filter)

# ---- group: Representation refs
get_geo_refs = Panel(".Representations[0].ref")
concat_4 = Concatenate(FragmentA=jsonpath_filter_2, FragmentB=get_geo_refs)
jsonpath = GhPythonScript(object=all_ifc_objects_2, path=concat_4)  # -> out, flatten(value)
# ---------- jsonpath: Python ----------
__author__ = "denni"
__version__ = "2020.04.28"

import rhinoscriptsyntax as rs
import re
import sys

def normalize(x):
    """normalize the path expression; outside jsonpath to allow testing"""
    subx = []

    # replace index/filter expressions with placeholders
    # Python anonymous functions (lambdas) are cryptic, hard to debug
    def f1(m):
        n = len(subx)   # before append
        g1 = m.group(1)
        subx.append(g1)
        ret = "[#%d]" % n
    #       print("f1:", g1, ret)
        return ret
    x = re.sub(r"[\['](\??\(.*?\))[\]']", f1, x)

    # added the negative lookbehind -krhodes
    x = re.sub(r"'?(?<!@)\.'?|\['?", ";", x)

    x = re.sub(r";;;|;;", ";..;", x)

    x = re.sub(r";$|'?\]|'$", "", x)

    # put expressions back
    def f2(m):
        g1 = m.group(1)
    #       print("f2:", g1)
        return subx[int(g1)]

    x = re.sub(r"#([0-9]+)", f2, x)

    return x


def jsonpath(obj, expr, result_type='VALUE', debug=0, use_eval=True):
    """traverse JSON object using jsonpath expr, returning values or paths"""


    def s(x,y):
        """concatenate path elements"""
        return str(x) + ';' + str(y)

    def isint(x):
        """check if argument represents a decimal integer"""
        return x.isdigit()

    def as_path(path):
        """convert internal path representation to
           "full bracket notation" for PATH output"""
        p = '$'
        for piece in path.split(';')[1:]:
            # make a guess on how to index
            # XXX need to apply \ quoting on '!!
            if isint(piece):
                p += "[%s]" % piece
            else:
                p += "['%s']" % piece
        return p

    def store(path, object):
        if result_type == 'VALUE':
            result.append(object)
        elif result_type == 'IPATH': # Index format path (Python ext)
            # return list of list of indices -- can be used w/o "eval" or split
            result.append(path.split(';')[1:])
        else: # PATH
            result.append(as_path(path))
        return path

    def trace(expr, obj, path):
        if debug: print("trace", expr, "/", path)
        if expr:
            x = expr.split(';')
            loc = x[0]
            x = ';'.join(x[1:])
            if debug: print("\t", loc, type(obj))
            if loc == "*":
                def f03(key, loc, expr, obj, path):
                    if debug > 1: print("\tf03", key, loc, expr, path)
                    trace(s(key, expr), obj, path)
                walk(loc, x, obj, path, f03)
            elif loc == "..":
                trace(x, obj, path)
                def f04(key, loc, expr, obj, path):
                    if debug > 1: print("\tf04", key, loc, expr, path)
                    if isinstance(obj, dict):
                        if key in obj:
                            trace(s('..', expr), obj[key], s(path, key))
                    else:
                        if key < len(obj):
                            trace(s('..', expr), obj[key], s(path, key))
                walk(loc, x, obj, path, f04)
            elif loc == "!":
                # Perl jsonpath extension: return keys
                def f06(key, loc, expr, obj, path):
                    if isinstance(obj, dict):
                        trace(expr, key, path)
                walk(loc, x, obj, path, f06)
            elif isinstance(obj, dict) and loc in obj:
                trace(x, obj[loc], s(path, loc))
            elif isinstance(obj, list) and isint(loc):
                iloc = int(loc)
                if debug: print("----->", iloc, len(obj))
                if len(obj) > iloc:
                    trace(x, obj[iloc], s(path, loc))
            else:
                # [(index_expression)]
                if loc.startswith("(") and loc.endswith(")"):
                    if debug > 1: print("index", loc)
                    e = evalx(loc, obj)
                    trace(s(e,x), obj, path)
                    return

                # ?(filter_expression)
                if loc.startswith("?(") and loc.endswith(")"):
                    if debug > 1: print("filter", loc)
                    def f05(key, loc, expr, obj, path):
                        if debug > 1: print("f05", key, loc, expr, path)
                        if isinstance(obj, dict):
                            eval_result = evalx(loc, obj[key])
                        else:
                            eval_result = evalx(loc, obj[int(key)])
                        if eval_result:
                            trace(s(key, expr), obj, path)

                    loc = loc[2:-1]
                    walk(loc, x, obj, path, f05)
                    return

                m = re.match(r'(-?[0-9]*):(-?[0-9]*):?(-?[0-9]*)$', loc)
                if m:
                    if isinstance(obj, (dict, list)):
                        def max(x,y):
                            if x > y:
                                return x
                            return y

                        def min(x,y):
                            if x < y:
                                return x
                            return y

                        objlen = len(obj)
                        s0 = m.group(1)
                        s1 = m.group(2)
                        s2 = m.group(3)

                        # XXX int("badstr") raises exception
                        start = int(s0) if s0 else 0
                        end = int(s1) if s1 else objlen
                        step = int(s2) if s2 else 1

                        if start < 0:
                            start = max(0, start+objlen)
                        else:
                            start = min(objlen, start)
                        if end < 0:
                            end = max(0, end+objlen)
                        else:
                            end = min(objlen, end)

                        for i in xrange(start, end, step):
                            trace(s(i, x), obj, path)
                    return

                # after (expr) & ?(expr)
                if loc.find(",") >= 0:
                    # [index,index....]
                    for piece in re.split(r"'?,'?", loc):
                        if debug > 1: print("piece", piece)
                        trace(s(piece, x), obj, path)
        else:
            store(path, obj)

    def walk(loc, expr, obj, path, funct):
        if isinstance(obj, list):
            for i in xrange(0, len(obj)):
                funct(i, loc, expr, obj, path)
        elif isinstance(obj, dict):
            for key in obj:
                funct(key, loc, expr, obj, path)

    def evalx(loc, obj):
        """eval expression"""

        if debug: print("evalx", loc)

        # a nod to JavaScript. doesn't work for @.name.name.length
        # Write len(@.name.name) instead!!!
        loc = loc.replace("@.length", "len(__obj)")

        loc = loc.replace("&&", " and ").replace("||", " or ")

        # replace !@.name with 'name' not in obj
        # XXX handle !@.name.name.name....
        def notvar(m):
            return "'%s' not in __obj" % m.group(1)
        loc = re.sub("!@\.([a-zA-Z@_0-9-]*)", notvar, loc)

        # replace @.name.... with __obj['name']....
        # handle @.name[.name...].length
        def varmatch(m):
            def brackets(elts):
                ret = "__obj"
                for e in elts:
                    if isint(e):
                        ret += "[%s]" % e # ain't necessarily so
                    else:
                        ret += "['%s']" % e # XXX beware quotes!!!!
                return ret
            g1 = m.group(1)
            elts = g1.split('.')
            if elts[-1] == "length":
                return "len(%s)" % brackets(elts[1:-1])
            return brackets(elts[1:])

        loc = re.sub(r'(?<!\\)(@\.[a-zA-Z@_.0-9]+)', varmatch, loc)

        # removed = -> == translation
        # causes problems if a string contains =

        # replace @  w/ "__obj", but \@ means a literal @
        loc = re.sub(r'(?<!\\)@', "__obj", loc).replace(r'\@', '@')
        if not use_eval:
            if debug: print("eval disabled")
            raise Exception("eval disabled")
        if debug: print("eval", loc)
        try:
            # eval w/ caller globals, w/ local "__obj"!
            v = eval(loc, caller_globals, {'__obj': obj})
        except Exception as e:
            if debug: print(repr(e))
            return False

        if debug: print("->", v)
        return v

    # body of jsonpath()

    # Get caller globals so eval can pick up user functions!!!
    caller_globals = sys._getframe(1).f_globals
    result = []
    if expr and obj:
        cleaned_expr = normalize(expr)
        if cleaned_expr.startswith("$;"):
            cleaned_expr = cleaned_expr[2:]

        # XXX wrap this in a try??
        trace(cleaned_expr, obj, '$')

        if len(result) > 0:
            return result
    return False

# Main payload
#path='$..'



format = 'VALUE'

value = jsonpath(object, path, format)

print(object)
# ---------- end jsonpath ----------

# ----
jsonpath_2 = GhPythonScript(object=all_ifc_objects_2, path="$..data[?(@.type == 'ShapeRepresentation')].GlobalId")  # -> out, flatten(value); same code as jsonpath
fsim = FindSimilarMember(Data=jsonpath.value, Set=jsonpath_2.value)  # -> Hit, Index

jsonpath_3 = GhPythonScript(object=all_ifc_objects_2, path="$..data[?(@.type == 'ShapeRepresentation')].Items[0]")  # -> out, flatten(value); same code as jsonpath
item_2 = ListItem(List=jsonpath_3.value, Index=fsim.Index, Wrap=True)

# ---- group: Display OBJs
parseobjtext = PythonScript(stringIn=item_2)  # -> out, a, b, center
# ---------- parseobjtext: Python ----------
import Rhino.Geometry as rg
pts=[]
faces=[]
lines = stringIn.splitlines()

for line in lines:
    print(line)
    if line.find("v")==0 and line.find("n")==-1 and line.find("t")==-1:
        print line.split(' ')
        #myPt = rg.Point3d(float((line.split(' '))[1]),float((line.split(' '))[2]),float((line.split(' '))[3]))
        pts.Add(rg.Point3d(float((line.split(' '))[1]),float((line.split(' '))[2]),float((line.split(' '))[3])))
    if line.find("f")==0:
        if line.split(' ').Count==4:
            faces.Add(rg.MeshFace(int(line.split(' ')[1].split('/')[0])-1,int(line.split(' ')[2].split('/')[0])-1,int(line.split(' ')[3].split('/')[0])-1))
        if line.split(' ').Count==5:
            faces.Add(rg.MeshFace(int(line.split(' ')[1].split('/')[0])-1,int(line.split(' ')[2].split('/')[0])-1,int(line.split(' ')[3].split('/')[0])-1,int(line.split(' ')[4].split('/')[0])-1))

temppoint=[pts[i] for i in range(len(pts))]
tempx=sum(i.X for i in temppoint)
tempy=sum(i.Y for i in temppoint)
tempz=sum(i.Z for i in temppoint)
tempvalues=len(pts)
center=rg.Point3d(tempx/tempvalues,tempy/tempvalues,tempz/tempvalues)

a=pts
b=faces
# ---------- end parseobjtext ----------
construct_mesh = ConstructMesh(Vertices=parseobjtext.a, Faces=parseobjtext.b)  # -> flatten(Mesh)
center_points = Data(parseobjtext.center)
all_meshes = Data(construct_mesh)

# ----
all_ifc_objects_3 = Data(all_ifc_objects)  # disabled
jsonpath_filter_3 = Data(jsonpath_filter)  # disabled
all_meshes_2 = Data(all_meshes)  # disabled

center_points_2 = Data(center_points)

# ---- group: Text Tags
all_ifc_objects_4 = Data(all_ifc_objects)
jsonpath_filter_4 = Data(jsonpath_filter)
panel_6 = Panel(".ObjectType")
panel_7 = Panel(".Name")
concat_5 = Concatenate(FragmentA=jsonpath_filter_4, FragmentB=".Volume")
jsonpath_4 = GhPythonScript(object=all_ifc_objects_4, path=concat_5)  # -> out, flatten(value); same code as jsonpath
int = Integer(jsonpath_4.value)
swatch = ColourSwatch(SwatchColor=RGB(242, 242, 242))
tag = TextTag(Location=center_points_2, Text=int, Colour=swatch)
tag_2 = TextTag3D(Location=center_points_2, Text=int, Size=10, Colour=swatch, Justification=8)  # disabled

# ---- group: Color by Volume
get_geo_refs_2 = Panel(".Volume")  # disabled
concat_6 = Concatenate(FragmentA=jsonpath_filter_3, FragmentB=get_geo_refs_2)  # disabled
jsonpath_5 = GhPythonScript(object=all_ifc_objects_3, path=concat_6)  # -> out, flatten(value); disabled; same code as jsonpath

# ----
bnd = Bounds(Numbers=jsonpath_5.value)  # disabled
dedomain = DeconstructDomain(Domain=bnd)  # -> Start, End; disabled
gradient = Gradient(
    LowerLimit=dedomain.Start,
    UpperLimit=dedomain.End,
    Parameter=jsonpath_5.value,
    stops=[0: RGB(0, 128, 0), 0.437: RGB(255, 255, 0), 0.91: RGB(255, 0, 0)])  # disabled
preview = CustomPreview(Geometry=all_meshes_2, Material=gradient)  # disabled

# ---- group: Color by Class
all_meshes_3 = Data(all_meshes)
all_ifc_objects_5 = Data(all_ifc_objects)
jsonpath_filter_5 = Data(jsonpath_filter)
panel_8 = Panel("""Column
Beam
Wall
Footing
Roof
Slab
Space
FurnishingElement
BuildingElementProxy
Window
Door""")
panel_9 = Panel("""128,128,128
0,0,255
255,255,0
255,255,70
0,255,255
255,0,0
80,80,80
0,0,255,25
255,0,255
255,255,255
50,50,100,50
102,48,11""")

get_class_value = Panel(".Class")
concat_7 = Concatenate(FragmentA=jsonpath_filter_5, FragmentB=get_class_value)
jsonpath_6 = GhPythonScript(object=all_ifc_objects_5, path=concat_7)  # -> out, flatten(value); same code as jsonpath

fsim_2 = FindSimilarMember(Data=jsonpath_6.value, Set=panel_8)  # -> Hit, Index
item_3 = ListItem(List=panel_9, Index=fsim_2.Index, Wrap=False)
preview_2 = CustomPreview(Geometry=all_meshes_3, Material=item_3)
